% Simulink data dictionary ElectricMachine3.sldd

PlntEM3ExtSplySerRes = 0
PlntEM3RotDamp = 0.001
PlntEM3RotInertia = 0.01
PlntEM3RotInitSpd = 0
PlntEM3TimeCnst = 0.02
PlntEM3Spd = [0 139.6263 279.2527 418.879 468.8889 558.5054 698.1317 837.758 977.3844 1117.011 1256.637 1396.263 1535.89 1675.516]
PlntEM3Trq = [450 450 450 450 450 377.794 302.2352 251.8627 215.8823 188.897 167.9085 151.1176 137.3797 125.9313]
PlntEM3SpdEff = [0 139.6263 279.2527 418.879 468.8889 558.5054 698.1317 837.758 977.3844 1117.011 1256.637 1396.263 1535.89 1675.516]
PlntEM3TrqEff = [0 45 90 135 180 225 270 315 360 405 450]

PlntEM3EffTbl = [52 78 80 82 82 80 78 78 76 74 70
 52 78 80 82 82 80 78 78 76 74 70
 52 78 84 86 86 86 86 84 84 82 82
 52 80 86 86 88 88 88 86 86 84 84
 52 80 86 88 88 88 88 88 86 86 86
 52 80 86 88 90 90 90 90 88 88 88
 52 82 88 90 91 91 92 92 92 91 91
 52 82 88 91 91 92 93 93 93 93 93
 52 84 90 92 92 93 93 93 93 93 93
 62 86 91 93 93 93 93 93 93 93 93
 66 86 91 93 93 93 93 93 93 93 93
 70 86 92 93 93 93 93 93 93 93 93
 70 86 92 93 93 93 93 93 93 93 93
 72 86 91 93 93 93 93 93 93 93 93]

PlntEM3SpdLoss = [0 139.6263 279.2527 418.879 468.8889 558.5054 698.1317 837.758 977.3844 1117.011 1256.637 1396.263 1535.89 1675.516]
PlntEM3TrqLoss = [0 45 90 135 180 225 270 315 360 405 450]
PlntEM3TrqLossTbl = repmat(0, 14, 11)