% Simulink data dictionary ElectricalThermalSystem.sldd

PlntThrTankVol = 5.3
PlntThrValDisp = 0.0063
PlntThrValDratioMax = 0.95
PlntThrValDratioMin = 0.001
PlntThrValSplMax = 0.0053
PlntThrRadWallThk = 0.0001
PlntThrRadWallK = 240
PlntThrCabDucArea = 0.04
PlntThrRadLength = 0.6
PlntThrRadWidth = 0.015
PlntThrRadTubeHeight = 0.0015
PlntThrRadThermalR = Simulink.Parameter(Simulink.data.Expression(ExpressionString="PlntThrRadWallThk/PlntThrRadAirAreaPr/PlntThrRadWallK"))
PlntThrEqLength = Simulink.Parameter(Simulink.data.Expression(ExpressionString="20*PlntThrChDia*4"))
PlntThrPipeArea = Simulink.Parameter(Simulink.data.Expression(ExpressionString="pi*PlntThrPipeDia^2/4"))
PlntThrChArea = Simulink.Parameter(Simulink.data.Expression(ExpressionString="pi*PlntThrChDia^2/4"))
PlntThrRadTubeLEq = Simulink.Parameter(Simulink.data.Expression(ExpressionString="2*(PlntThrRadHeight+20*PlntThrRadTubeHeight*PlntThrRadNTubes)"))
PlntThrRadMoistAirVol = Simulink.Parameter(Simulink.data.Expression(ExpressionString="PlntThrRadAirAreaFlw*PlntThrRadWidth"))
PlntThrRadFinSpace = 0.002
PlnThrRadAirAreaFins = Simulink.Parameter(Simulink.data.Expression(ExpressionString="2*PlntThrRadNFins*PlntThrRadWidth*PlntThrRadGapHeight"))
PlntThrCabRelHInit = 0.4
PlntThrCabCO2Init = 0.0004
PlntThrCycNomHeatflw = 9
PlntThrCycCondRefPin = 1340
PlntThrCycChlrRefPin = 300
PlntThrCycCondRefVol = 0.001
PlntThrCycChlrRefVol = 0.001
PlntThrRefrigAinit = 0.6
PlntThrCycCondAirFlw = 1.15
PlntThrCondNomAirDP = 100
PlntThrCondNomPin = 101300
PlntThrCondNomTin = 303.15
PlntThrCondNomRelH = 0.4
PlntThrCycCondNomVol = 0.005
PlntThrCycChlrH2OFlw = 0.3
PlntThrCycChlrH2ODP = 100
PlntThrCycChlrH2OPin = 101300
PlntThrCycChlrH2OTin = 303.15
PlntThrCycChlrH2OVol = 0.002
PlntThrTankArea = 0.0121
PlntThrEstHeatFlw = 9
PlntThrEstCOP = 4
PlantThrEstCmpPwr = Simulink.Parameter(Simulink.data.Expression(ExpressionString="PlntThrEstHeatFlw/PlntThrEstCOP"))
PlntThrEstCondTemp = 303.15
PlntThrEstEvapTemp = 288.15
PlntThrEstDTLut = Simulink.Parameter(Simulink.data.Expression(ExpressionString="[0 1 2]*(PlntThrEstCondTemp-PlntThrEstEvapTemp)"))
PlntThrEstCOPLut = Simulink.Parameter(Simulink.data.Expression(ExpressionString="[1.2 1 0.1]*PlntThrEstCOP"))
PlntThrCabHydDia = Simulink.Parameter(Simulink.data.Expression(ExpressionString="2*sqrt(PlntThrCabDucArea/pi)"))
PlntThrDCJacArea = Simulink.Parameter(Simulink.data.Expression(ExpressionString="PlntThrDCJacLen*pi*PlntThrChDia"))
PlntThrPmpHeadP = 100000
PlntThrHeaterMaxPwr = 4000
PlntThrHeaterJacArea = 1
PlntThrHeaterJacVol = 0.001
PlntThrHeaterCoeff = 200
PlntThrAirBpt = [248.15 263.15 273.15 283.15 293.15 298.15 303.15 313.15 333.15 373.15 473.15 573.15]
PlntThrAirRho = [1.42 1.341 1.2922 1.2466 1.204 1.18 1.16 1.1 1.025 0.916 0.723 0.596]
PlntThrFanMaxSpd = 3000
PlntThrFanMechEff = 0.9
PlntThrFanNomP = 400
PlntThrAirCp = [1011 1012 1014 1017 1019 1022 1035]
PlntThrAirCpBpt = [273.15 293.15 313.15 333.15 353.15 373.15 473.15]
PlntThrRadFinEff = 0.7
PlntThrRadAirArea = Simulink.Parameter(Simulink.data.Expression(ExpressionString="PlntThrRadAirAreaPr+PlntThrRadFinEff*PlnThrRadAirAreaFins"))
PlntThrRadCoolArea = Simulink.Parameter(Simulink.data.Expression(ExpressionString="PlntThrRadNTubes*PlntThrRadLength*PlntThrRadTubeDh"))

PlntThrRadGapHeight = Simulink.Parameter(Simulink.data.Expression(
  ExpressionString="(PlntThrRadHeight-PlntThrRadNTubes*PlntThrRadTubeHeight)/(PlntThrRadNTubes+1)"))

PlntThrRadAirAreaPr = Simulink.Parameter(Simulink.data.Expression(
  ExpressionString="2*(PlntThrRadNTubes+1)*PlntThrRadWidth*(PlntThrRadLength+PlntThrRadGapHeight)"))

PlntThrRadNFins = Simulink.Parameter(Simulink.data.Expression(ExpressionString="(PlntThrRadNTubes+1)*PlntThrRadLength/PlntThrRadFinSpace"))
PlntThrAirCond = [0.0237 0.0251 0.0265 0.0279 0.0293 0.0307 0.037]
PlntThrAirPrand = repmat(0.71, 1, 7)
PltnThrRadAirFoul = 0.1
PltnThrRadCoolFoul = 0.1
PlntThrCoolRho = [1098 1095 1090 1087 1083 1079 1074 1069 1065 1060 1054 1049 1043 1037 1031 1025 1018 1011 1004 997]
PlntThrCoolCpBpt = [233 241 250 258 266 275 283 292 300 309 317 326 334 342 351 359 368 376 385 393]
PlntThrCoolCp = [2939 3006 3072 3135 3195 3253 3307 3359 3407 3452 3493 3530 3563 3592 3618 3638 3654 3666 3672 3674]
PlntThrCoolCond = [0.4331 0.4308 0.4285 0.4261 0.4238 0.4214 0.419 0.4167 0.4143 0.412 0.4096 0.4072 0.4049 0.4026 0.4002 0.3979 0.3957 0.3934 0.3912 0.3889]
PlntThrCoolViscP = [76.42 49.31 32.24 21.39 14.42 9.9 6.93 4.95 3.62 2.71 2.08 1.64 1.33 1.12 0.964 0.861 0.796 0.764 0.761 0.788]
PlntThrCoolPrand = [518 344 231 157 109 76.4 54.7 39.9 29.8 22.7 17.8 14.2 11.7 9.96 8.72 7.87 7.36 7.12 7.14 7.44]
PlntThrAirVisc6 = [17.456 18.24 19.123 19.907 20.79 21.673 25.693]
PlntThrAirVisc = Simulink.Parameter(Simulink.data.Expression(ExpressionString="PlntThrAirVisc6/1000000"))
PlntThrCoolVisc = Simulink.Parameter(Simulink.data.Expression(ExpressionString="PlntThrCoolViscP/1000"))
PlntThrChDia = 0.019
PlntThrPipeDia = 0.025
PlntThrRadNTubes = 38
PlntThrPmpMaxSpd = 1500
PlntThrPmpDisp = 0.03
PlntThrRadRamEff = 0.95
PlntThrPmpVolEff = 0.9
PlntThrPmpMechEff = 0.996
PlntThrBattDCFlwRatio = 0.75
PlntThrConvCoeff = 850
PlntThrRadHeight = 0.4
PlntThrFanVolEff = 0.85

PlntThrRadTubeDh = Simulink.Parameter(Simulink.data.Expression(
  ExpressionString="2*PlntThrRadWidth*PlntThrRadTubeHeight/(PlntThrRadWidth+PlntThrRadTubeHeight)"))

PlntThrRadAirDh = Simulink.Parameter(Simulink.data.Expression(
  ExpressionString="2*PlntThrRadLength*PlntThrRadGapHeight/(PlntThrRadLength+PlntThrRadGapHeight)"))

PlntThrDCJacLen = 1.2
PlntThrBattJacLen = 1.8
PlntThrEMJacLen = 2.4
PlntThrInvJacLen = 1.2
PlntThrEMJacArea = Simulink.Parameter(Simulink.data.Expression(ExpressionString="PlntThrEMJacLen*pi*PlntThrChDia"))
PlntThrBattJacArea = Simulink.Parameter(Simulink.data.Expression(ExpressionString="4*PlntThrBattJacLen*pi*PlntThrChDia"))
PlntThrFanDisp = 24.2
CtrlThrBattTrgTemp = 298.15
CtrlThrEMTrgTemp = 313.15
PlntThrRadFanAreaFlw = Simulink.Parameter(Simulink.data.Expression(ExpressionString="0.7*PlntThrRadAirAreaFlw"))
PlntThrRadFlwCoef = 0.3
PlntThrRadAirAreaFlw = Simulink.Parameter(Simulink.data.Expression(ExpressionString="(PlntThrRadNTubes+1)*PlntThrRadLength*PlntThrRadGapHeight*0.9"))  % Added a 0.9 correction factor to account for fin thickness and fin louvers
PlntThrHtVsCurr = [1200 0 1200]
PlntThrHtVsCurrBpt = [-200 0 200]