% Simulink data dictionary Trailer.sldd

PlntTraAeroDragCff = 0.15
PlntTraAeroFrntArea = 8.16
PlntTraAeroLiftCff = 0.1
PlntTraAeroPitchCff = 0.1
PlntTraCGHgtAxl = 0.5
PlntTraFrntUnsprgMass = 100
PlntTraFzFlt = 10
PlntTraInitLatVel = 0
PlntTraInitLongVel = 0
PlntTraInitPitchAng = 0
PlntTraInitPitchRate = 0
PlntTraInitRollAng = 0
PlntTraInitRollRate = 0
PlntTraInitVertVel = 0
PlntTraInitYawAng = 0
PlntTraInitYawRate = 0
PlntTraNumWhlFrntAxl = 2
PlntTraNumWhlRearAxl = 2
PlntTraRearUnsprgMass = 100
PlntTraRollResCffa = 196
PlntTraRollResCffb = 2.232
PlntTraSuspHmax = 0.25
PlntTraTrckWdth = 2.55
PlntTraNumWhlMiddleAxl = 2
PlntTraMass = 400
PlntTraDstCGFrntAxl = 1
PlntTraDstCGRearAxl = 1.5
PlntTraRollMomentInertia = 108.0825
PlntTraPitchMomentInertia = 480.6675
PlntTraYawMomentInertia = 516.5
PlntTraSuspKz = 24564
PlntTraSuspCz = 3518.6
PlntTraSuspF0z = 1526
PlntTraDstCGMiddleAxl = 1.25
PlntTraHtchHgtAxlFrnt = 0.2
PlntTraKzWhlAxl = 58429000
PlntTraF0zWhlAxl = 16132
PlntTraCzWhlAxl = 557960
PlntTraHtchCxy = 9047.8
PlntTraHtchCz = 2010.6
PlntTraHtchF0z = 872
PlntTraHtchKxy = 63165
PlntTraHtchKz = 14037
PlntTraWhlLongSpd = 16.7
PlntTraWhlMass = 11.2
PlntTraWhlMaxCmbr = 0.17453
PlntTraWhlMaxFz = 8600
PlntTraWhlMaxPress = 1000000
PlntTraWhlMaxSlipAngle = 1.5
PlntTraWhlMaxSlipRatio = 1.5
PlntTraWhlMinCmbr = -0.17453
PlntTraWhlMinFz = 100
PlntTraWhlMinPress = 10000
PlntTraWhlMinSlipAngle = -1.5
PlntTraWhlMinSlipRatio = -1.5
PlntTraWhlNomNorlForce = 4300
PlntTraWhlNomPress = 262000
PlntTraWhlRimRadius = 0.2286
PlntTraWhlUnldRadius = 0.33454
PlntTraWhlVelTolLowVel = 1
PlntTraWhlVertDampCoeff = 500
PlntTraWhlWidth = 0.235
PlntTraWhlInitAngVel = 0
PlntTraWhlDampCoeff = [0.0010005 0.0010005]
PlntTraWhlInertia = [1.084 1.084]
PlntTraWhlCambStiff = 10000
PlntTraWhlCompDamp = 50000
PlntTraWhlCompStiff = 500000
PlntTraWhlDampCoeffFrnt = 0.001
PlntTraWhlDampCoeffRear = 0.001
PlntTraWhlHubCompDamp = 40000
PlntTraWhlHubCompStiff = 1000000
PlntTraWhlInertiaFrnt = 0.8
PlntTraWhlInertiaRear = 0.8
PlntTraWhlInitAngVelRear = 0
PlntTraWhlInitVel = 0
PlntTraWhlKinFricCff = 0.5
PlntTraWhlLatStiff = 45000
PlntTraWhlLdRadius = 0.327
PlntTraWhlLnrVelForceComp = 0
PlntTraWhlLongCuvFctr = 0.97
PlntTraWhlLongPeakFctr = 1
PlntTraWhlLongScaleFctr = 0.9
PlntTraWhlLongShapeFctr = 1.9
PlntTraWhlLongStfFctr = 10
PlntTraWhlLongStiff = 500000
PlntTraWhlMassFrnt = 11.2
PlntTraWhlMassRear = 11.2
PlntTraWhlNrmlForceExp = 1
PlntTraWhlPrsFrnt = 220000
PlntTraWhlPrsRear = 220000
PlntTraWhlQuadVelForceComp = 0
PlntTraWhlRlxLngth = 0.15
PlntTraWhlRlxLngthFrnt = 0.1
PlntTraWhlRlxLngthLat = 0.15
PlntTraWhlRlxLngthLatFrnt = 0.1
PlntTraWhlRlxLngthLatRear = 0.1
PlntTraWhlRlxLngthRear = 0.1
PlntTraWhlRollResVelThresh = 0.1
PlntTraWhlStcFricCff = 0.8
PlntTraWhlTirPrsExp = 0
PlntTraWhlVelIndpntForceCff = 0.01
PlntTraWhlVelThresh = 0.1
PlntTraWhlVertDampCoeffFrnt = 1000
PlntTraWhlVertDampCoeffRear = 1000
PlntTraVehFzFlt = 10
PlntTraInitVertPos = 0
PlntTraAxlM = 20
PlntTraAxlIxx = 2
PlntTraBrkActrBoreFrnt = 0.05
PlntTraBrkKinFricCffFrnt = 0.35
PlntTraBrkNumPadsFrnt = 2
PlntTraBrkPadMeanRadiusFrnt = 0.15
PlntTraBrkStcFricCffFrnt = 0.45
PlntTraInitLongPos = -4
PlntTraHtchDstFrnt = 1.75
PlntTraInitLatPos = 5.7