% Simulink data dictionary VirtualVehicleTemplate.sldd
% references BatteryDCDC.sldd
% references Drivetrain.sldd
% references ElectricMachine1.sldd
% references ElectricMachine2.sldd
% references FuelCellElectricSystem.sldd
% references PassVeh.sldd
% references Trailer.sldd
% references HevPxVCU.sldd
% references HevIpsVCU.sldd
% references HevMmVCU.sldd
% references VehicleConfig.sldd
% references Driver.sldd
% references Environment.sldd
% references Scenario.sldd
% references EvVCU.sldd
% references ElectricMachine3.sldd
% references ElectricMachine4.sldd
% references ElectricalCoolingSystem.sldd
% references PassVehMultibody.sldd
% references VirtualDynoTemplate.sldd
% references ElectricalThermalSystem.sldd
% references DLBattery.sldd

AccBUS = Simulink.Bus()
  ax: double, Unit="gee"
  ay: double, Unit="gee"
  az: double, Unit="gee"
  xddot: double, Unit="m/s^2"
  yddot: double, Unit="m/s^2"
  zddot: double, Unit="m/s^2"

AngBUS = Simulink.Bus()
  phi: double, Unit="rad"
  theta: double, Unit="rad"
  psi: double, Unit="rad"

AngAccBUS = Simulink.Bus()
  pdot: double
  qdot: double
  rdot: double

AngGeomBUS = Simulink.Bus()
  Beta: double

BMSSensorsBUS = Simulink.Bus()
  CellVoltages: single[PlntBattNumCellSer]
  PackVoltage: single
  PackCurrent: single
  CellTemperatures: single[PlntBattNumCellSer]
  VoutChgr: single
  VoutInvtr: single

BattInfoBUS = Simulink.Bus()
  BattCurr: double
  BattAmpHr: double
  BattSoc: double
  BattVolt: double
  BattPwr: double
  BattPwrLoss: double
  BattTemp: double

BodyBUS = Simulink.Bus()
  Fx: double
  Fy: double
  Fz: double

BodyMBUS = Simulink.Bus()
  Mx: double
  My: double
  Mz: double

DCDCBUS = Simulink.Bus()
  PwrELoss: double
  PwrETemp: double

DcuBUS = Simulink.Bus()
  DiffrntlPrsCmd: double[4]
  DiffrntlTrqCmd: double

DispBBUS = Simulink.Bus()
  x: double, Unit="m"
  y: double, Unit="m"
  z: double, Unit="m"

DispIBUS = Simulink.Bus()
  X: double, Unit="m"
  Y: double, Unit="m"
  Z: double, Unit="m"

DispITrlrBUS = Simulink.Bus()
  X: double
  Y: double

DragBUS = Simulink.Bus()
  Fx: double
  Fy: double
  Fz: double

DragMBUS = Simulink.Bus()
  Mx: double
  My: double
  Mz: double

DrivelineBUS = Simulink.Bus()
  EngSpd: double, Unit="rpm"
  EMSpd: double, Unit="rpm"
  TransGear: int8, Unit="one"

EMBUS = Simulink.Bus()
  EMPwrElec: double[PlntEMNum]
  EMTrq: double[PlntEMNum]
  EMSpd: double[PlntEMNum], Unit="rad/s"
  EMMechPwr: double[PlntEMNum]
  EMPwrLoss: double[PlntEMNum]
  EMTemp: double[PlntEMNum]

EcuBUS = Simulink.Bus()
  ThrPosPctCmd: double
  WgAreaPctCmd: double
  InjPw: double
  FuelMainSoi: double
  SpkAdv: double
  IntkCamPhaseCmd: double
  ExhCamPhaseCmd: double
  TurboRackPosCmd: double
  EgrVlvAreaPctCmd: double
  VarCompRatioPosCmd: double
  IntkVlvLiftCmd: double
  VarIntkRunLenCmd: double
  ClsdLpFuelMult: double
  IntkSwirlVlvPosCmd: double
  TrqCmd: double
  LoadCmd: double
  EstIntkPortFlw: double

EngBUS = Simulink.Bus()
  EngTrq: double
  EngSpd: double

ExtBUS = Simulink.Bus()
  Fx: double
  Fy: double
  Fz: double

ExtMBUS = Simulink.Bus()
  Mx: double
  My: double
  Mz: double

FrntTireBUS = Simulink.Bus()
  Fx: double[4526]
  Fy: double
  Fz: double

FuelCellBUS = Simulink.Bus()
  FuelCellVolt: double
  FuelCellCurr: double
  H2Flw: double

GndBUS = Simulink.Bus()
  mu: double[2]
  z: double[2]
  DCM: double[3 3 2]

GrvtyBUS = Simulink.Bus()
  Fx: double
  Fy: double
  Fz: double

HitchForcesBUS = Simulink.Bus()
  Fx: double
  Fy: double
  Fz: double

HitchMomentsBUS = Simulink.Bus()
  Mx: double
  My: double
  Mz: double

IMUBUS = Simulink.Bus()
  Acc: double[3]
  pqr: double[3]

LftForcesBUS = Simulink.Bus()
  Fx: double
  Fy: double
  Fz: double

LightsFdbkBUS = Simulink.Bus()
  HighBeamFdbk: boolean
  LowBeamFdbk: boolean
  BrakeLightFdbk: boolean
  ReverseLightFdbk: boolean
  LeftSignalFdbk: boolean
  RightSignalFdbk: boolean
  HazzardFdbk: boolean

PwrBUS = Simulink.Bus()
  PwrExt: double
  Drag: double

PwrNotTrnsfrdBUS = Simulink.Bus()
  PwrFxDrag: double

PwrStoredBUS = Simulink.Bus()
  PwrStoredGrvty: double
  PwrStoredxdot: double

PwrTrnsfrdBUS = Simulink.Bus()
  PwrFxExt: double

RearTireBUS = Simulink.Bus()
  Fx: double[4526]
  Fy: double
  Fz: double

RghtForcesBUS = Simulink.Bus()
  Fx: double
  Fy: double
  Fz: double

SOCBUS = Simulink.Bus()
  SOC_CC: single
  SOC_UKF: single
  SOC_EKF: single

SteerBUS = Simulink.Bus()
  WhlAngRL: double
  WhlAngRR: double

TcuBUS = Simulink.Bus()
  GearCmd: double

TransBUS = Simulink.Bus()
  TransSpdRatio: double
  TransEta: double
  TransGearCmd: double
  TransGear: double

VVCAccelCmdBUS = Simulink.Bus()
  EnblAccelCmd: boolean, Min=0, Max=1, Unit="one"  % Boolean signal used to override driver model accel commands with user specified inputs
  AccelCmd: double, Min=0, Max=1, Unit="one"  % Normalized accelerator input
  AccelHld: boolean, Min=0, Max=1, Unit="one"  % Boolean signal used to hold the current driver model accel output when true
  AccelZero: boolean, Min=0, Max=1, Unit="one"  % Boolean signal used to override driver model accel commands with zero when value is true

VVCDecelCmdBUS = Simulink.Bus()
  EnblDecelCmd: boolean, Min=0, Max=1, Unit="one"  % Boolean signal used to override driver model decel commands with user specified inputs
  DecelCmd: double, Min=0, Max=1, Unit="one"  % Normalized footpedal decelerator or brake input
  DecelHld: boolean, Min=0, Max=1, Unit="one"  % Boolean signal used to hold the current driver model decel output when true
  DecelZero: boolean, Min=0, Max=1, Unit="one"  % Boolean signal used to override driver model decel commands with zero when value is true
  HndBrkCmd: double, Min=0, Max=1, Unit="one"  % Normalized handbrake / park brake input

VVCDrvRefBUS = Simulink.Bus()
  LngRef: double, Unit="m/s"  % Longitudinal reference velocity
  LtrRef: double, Unit="m"
  XRef: double, Unit="m"  % X reference pose
  YRef: double, Unit="m"  % Y reference pose
  PhiRef: double, Unit="rad"  % Confirmation needed on coords and angular range / units (yaw angle or phi for angular reference)
  CurvRef: double, Unit="1/m"  % Reference path curvature
  CurvGradRef: double, Unit="1/m^2"  % reference curvature gradient (as a function of station)

VVCEnvBUS = Simulink.Bus()
  BaroPress: double, Min=0, Unit="pascal"
  AmbTemp: double, Min=0, Unit="kelvin"
  Wind: double[3], Unit="m/s"  % Wind veloicty in the global inertial frame
  Grade: double, Min=0, Unit="deg"

VVCGndSTI4wBUS = Simulink.Bus()
  X: double[4], Unit="m"
  Y: double[4], Unit="m"
  Z: double[4], Unit="m"
  lambda_mux: double[4], Min=0, Unit="one"
  lambda_muy: double[4], Min=0, Unit="one"
  VX: double[4], Unit="m/s"
  VY: double[4], Unit="m/s"
  VZ: double[4], Unit="m/s"
  DCM: double[3 3 4]
  OmegaX: double[4], Unit="rad/s"
  OmegaY: double[4], Unit="rad/s"
  OmegaZ: double[4], Unit="rad/s"
  dZdX: double[4], Unit="one"
  dZdY: double[4], Unit="one"

VVCGndSTI6wBUS = Simulink.Bus()
  X: double[6], Unit="m"
  Y: double[6], Unit="m"
  Z: double[6], Unit="m"
  lambda_mux: double[6], Min=0, Unit="one"
  lambda_muy: double[6], Min=0, Unit="one"
  VX: double[6], Unit="m/s"
  VY: double[6], Unit="m/s"
  VZ: double[6], Unit="m/s"
  DCM: double[3 3 6]
  OmegaX: double[6], Unit="rad/s"
  OmegaY: double[6], Unit="rad/s"
  OmegaZ: double[6], Unit="rad/s"
  dZdX: double[6], Unit="one"
  dZdY: double[6], Unit="one"

VVCSteerCmdAngBUS = Simulink.Bus()
  EnblSteerCmd: boolean, Min=0, Max=1, Unit="one"  % Boolean signal used to override driver model steering commands with user specified inputs
  SteerCmd: double, Unit="rad"  % Normalized handwheel input (steering column).
  SteerHld: boolean, Min=0, Max=1, Unit="one"  % Boolean signal used to hold the current driver model steering output when true
  SteerZero: boolean, Min=0, Max=1, Unit="one"  % Boolean signal used to override driver model steering commands with zero when value is true

VVCTransCmdBUS = Simulink.Bus()
  TransModeCmd: int8, Unit="one"  % Used to spec the mode of operation for the transmission (manual, automatic, sport, econ, etc)
  GearCmd: int8, Unit="one"  % Gear input (could be PRNDL or manual gear numbers) depending on mode of TransModeCmd
  UpShiftCmd: boolean, Unit="one"
  DwnShiftCmd: boolean, Unit="one"
  ClutchCmd: double, Min=0, Max=1, Unit="one"  % Normalized footpedal clutch input

VVCUserBUS = Simulink.Bus()
  UserDblCmd1: double
  UserInt8Cmd1: int8
  UserUint8Cmd1: uint8
  UserBoolCmd1: boolean

VcuBUS = Simulink.Bus()
  EngTrqCmd: double
  EMTrqCmd: double[PlntEMNum]
  VcuBrkPrsCmd: double[4]
  VcuTrlrBrkPrsCmd: double[6]
  Cltch1Cmd: double
  Neutral: double
  FuelCellCurrCmd: double
  FuelCellTempCmd: double

VehFrntBUS = Simulink.Bus()
  F: double[3,PlntWhlNumFrnt]
  M: double[3,PlntWhlNumFrnt]

VehRearBUS = Simulink.Bus()
  F: double[3,PlntWhlNumRear]
  M: double[3,PlntWhlNumRear]

VelBBUS = Simulink.Bus()
  xdot: double, Unit="m/s"
  ydot: double, Unit="m/s"
  zdot: double, Unit="m/s"

VelIBUS = Simulink.Bus()
  Xdot: double, Unit="m/s"
  Ydot: double, Unit="m/s"
  Zdot: double, Unit="m/s"

WhlAngBUS = Simulink.Bus()
  FL: double
  FR: double

WhlFrntBUS = Simulink.Bus()
  F: double[3,PlntWhlNumFrnt]
  xdot: double[1,PlntWhlNumFrnt]
  ydot: double[1,PlntWhlNumFrnt]
  Ang: double[3,PlntWhlNumFrnt]
  z: double[PlntWhlNumFrnt]
  AngVel: double[3,PlntWhlNumFrnt]

WhlRearBUS = Simulink.Bus()
  F: double[3,PlntWhlNumRear]
  xdot: double[1,PlntWhlNumRear]
  ydot: double[1,PlntWhlNumRear]
  Ang: double[3,PlntWhlNumRear]
  z: double[PlntWhlNumRear]
  AngVel: double[3,PlntWhlNumRear]

slBus19_SteerBUS = Simulink.Bus()
  WhlAngFL: double
  WhlAngFR: double

slBus1_WhlAngBUS = Simulink.Bus()
  RL: double
  RR: double

slBus27_PwrTrnsfrdBUS = Simulink.Bus()
  PwrFxExt: double
  PwrFwFx: double
  PwrFwRx: double

DiffBUS = Simulink.Bus()
  DiffTrq: double
  DiffSpd: double

AngVelBUS = Simulink.Bus()
  p: double, Unit="rad/s"
  q: double, Unit="rad/s"
  r: double, Unit="rad/s"

ThermalCuBUS = Simulink.Bus()
  ValveCmd: double
  PumpCmd: double
  CmpCmd: double
  FanCmd: double
  HeaterCmd: double
  MotPmpCmd: double
  BattPmpCmd: double
  ChlrByPCmd: double
  SerParCmd: double
  RadByPCmd: double

TrlrPwrBUS = Simulink.Bus()
  Ext: double
  HitchF: double
  HitchR: double
  Drag: double

TrlrSteeringBUS = Simulink.Bus()
  WheelAngles: double[2]
  CamberAngles: double[2]

TrlrSteeringBBUS = Simulink.Bus()
  WhlAngFL: double
  WhlAngFR: double

TrlrSuspensionBUS = Simulink.Bus()
  WhlAng: double[3 2]
  YawRate: double[2]
  Vx: double[2]
  Vy: double[2]
  Vz: double[2]
  Fext: double[2]
  dz: double[2]

TrlrTireFrameBUS = Simulink.Bus()
  Omega: double[2]
  Fx: double[2]
  Fy: double[2]
  Fz: double[2]
  Mx: double[2]
  My: double[2]
  Mz: double[2]
  Re: double[2]
  z: double[2]
  zdot: double[2]
  Kappa: double[2]
  Alpha: double[2]

FxBUS = Simulink.Bus()
  FxL: double
  FxR: double

OmegaBUS = Simulink.Bus()
  OmegaL: double
  OmegaR: double

BcuBUS = Simulink.Bus()
  ABSFlag: boolean[4]
  BrkPrsCmd: double[4]
  TrlrBrkPrsCmd: double[6]
  TCSFlag: double[4]
  ESCFlag: boolean

ThermalBUS = Simulink.Bus()
  InvCoolTempOut: double, Unit="K"
  InvTemp: double, Unit="K"
  BattTemp: double, Unit="K"
  MotorTemp: double
  ChlrPress: double, Unit="MPa"
  CondPress: double, Unit="MPa"
  EAccPwr: double
  BattCoolTemp: double, Unit="K"
  Qbatt: double
  Qpwre: double
  Qem: double[PlntEMNum]
  BattCoolMFlw: double

BMSBUS = Simulink.Bus()
  BMSInfo: BMSInfoBUS
  BMSCmd: BMSCmdBUS

BMSCmdBUS = Simulink.Bus()
  CurrentLimitsBus: CurrentLimitsBUS
  ChargeCurrentReq: single
  ContactorsCmdBus: ContactorsCmdBUS
  BalCmd: boolean[1 96]

BMSInfoBUS = Simulink.Bus()
  Faults: boolean
  BMSState: single
  SOC: SOCBUS

BatteryBUS = Simulink.Bus()
  BattInfo: BattInfoBUS
  BMSSensors: BMSSensorsBUS

CgBBUS = Simulink.Bus()
  Disp: Bus: DispBBUS
  Vel: Bus: VelBBUS
  AngVel: Bus: AngVelBUS
  Acc: Bus: AccBUS
  AngAcc: Bus: AngAccBUS

CgIBUS = Simulink.Bus()
  Disp: Bus: DispIBUS
  Vel: Bus: VelIBUS
  Ang: Bus: AngBUS

CtrlTxBUS = Simulink.Bus()
  Vcu: VcuBUS
  Engine: EcuBUS
  Trans: TcuBUS
  Brake: BcuBUS
  Diff: DcuBUS
  BMS: BMSBUS
  Thermal: ThermalCuBUS

DriverBUS = Simulink.Bus()
  SteerFdbk: double, Unit="rad"
  AccelFdbk: double
  DecelFdbk: double
  GearFdbk: double
  IgnFdbk: boolean
  LightsFdbk: LightsFdbkBUS

DriverCmdBUS = Simulink.Bus()
  SteerCmd: double
  AccelCmd: double
  DecelCmd: double
  GearCmd: double
  IgnSwtch: boolean
  LightsCmd: VVCLightsCmdBUS

ForcesBUS = Simulink.Bus()
  Body: BodyBUS
  Ext: ExtBUS
  FrntAxl: FrntAxlForcesBUS
  RearAxl: RearAxlForcesBUS
  Hitch: HitchForcesBUS
  Tires: TiresBUS
  Drag: DragBUS
  Grvty: GrvtyBUS

FrntAxlBBUS = Simulink.Bus()
  Lft: LftBBUS
  Rght: RghtBBUS

FrntAxlForcesBUS = Simulink.Bus()
  Lft: LftForcesBUS
  Rght: RghtForcesBUS

FrntAxlIBUS = Simulink.Bus()
  Lft: LftIBUS
  Rght: RghtIBUS

FrntSuspBUS = Simulink.Bus()
  FrntSuspChassis: FrntSuspChassisBUS
  FrntSuspWheel: FrntSuspWheelBUS

FrntSuspChassisBUS = Simulink.Bus()
  Veh: VehFrntBUS
  Whl: WhlFrntBUS

FrntSuspWheelBUS = Simulink.Bus()
  WhlAng: double[3,PlntWhlNumFrnt]
  YawRate: double[PlntWhlNumFrnt]
  Vx: double[PlntWhlNumFrnt]
  Vy: double[PlntWhlNumFrnt]
  Vz: double[PlntWhlNumFrnt]
  Fext: double[PlntWhlNumFrnt]
  dz: double[PlntWhlNumFrnt]
  Wheels: FWheelsBUS

FrntTiresBUS = Simulink.Bus()
  Lft: LftForcesBUS
  Rght: RghtForcesBUS

FrntWheelsBUS = Simulink.Bus()
  Wheels: FWheelsBUS
  Gnd: GndBUS

FrontBUS = Simulink.Bus()
  WhlAng: WhlAngBUS

GeomBBUS = Simulink.Bus()
  Disp: DispBBUS
  Vel: VelBBUS
  Ang: AngGeomBUS

GeomIBUS = Simulink.Bus()
  Disp: DispIBUS
  Vel: VelIBUS

HitchBBUS = Simulink.Bus()
  Disp: DispBBUS
  Vel: VelBBUS

HitchIBUS = Simulink.Bus()
  Disp: DispIBUS
  Vel: VelIBUS

InertFrmBUS = Simulink.Bus()
  Cg: CgIBUS
  FrntAxl: FrntAxlIBUS
  RearAxl: RearAxlIBUS
  Hitch: HitchIBUS
  Geom: GeomIBUS

InfoBUS = Simulink.Bus()
  Eng: EngBUS
  Diff: Bus: DiffBUS
  Trans: TransBUS

LftBBUS = Simulink.Bus()
  Disp: DispBBUS
  Vel: VelBBUS

LftIBUS = Simulink.Bus()
  Disp: DispIBUS
  Vel: VelIBUS

LftTrlrBUS = Simulink.Bus()
  Disp: DispITrlrBUS

MidlAxlBUS = Simulink.Bus()
  Lft: LftTrlrBUS
  Rght: RghtTrlrBUS

MomentsBUS = Simulink.Bus()
  Body: BodyMBUS
  Drag: DragMBUS
  Ext: ExtMBUS
  Hitch: HitchMomentsBUS

PwrInfoBUS = Simulink.Bus()
  PwrTrnsfrd: PwrTrnsfrdBUS
  PwrNotTrnsfrd: PwrNotTrnsfrdBUS
  PwrStored: PwrStoredBUS

RearBUS = Simulink.Bus()
  WhlAng: slBus1_WhlAngBUS

RearAxlBBUS = Simulink.Bus()
  Lft: LftBBUS
  Rght: RghtBBUS

RearAxlForcesBUS = Simulink.Bus()
  Lft: LftForcesBUS
  Rght: RghtForcesBUS

RearAxlIBUS = Simulink.Bus()
  Lft: LftIBUS
  Rght: RghtIBUS

RearSuspBUS = Simulink.Bus()
  RearSuspChassis: RearSuspChassisBUS
  RearSuspWheel: RearSuspWheelBUS

RearSuspChassisBUS = Simulink.Bus()
  Veh: VehRearBUS
  Whl: WhlRearBUS

RearSuspWheelBUS = Simulink.Bus()
  WhlAng: double[3,PlntWhlNumRear]
  YawRate: double[PlntWhlNumRear]
  Vx: double[PlntWhlNumRear]
  Vy: double[PlntWhlNumRear]
  Vz: double[PlntWhlNumRear]
  Fext: double[PlntWhlNumRear]
  dz: double[PlntWhlNumRear]
  Wheels: RWheelsBUS

RearTiresBUS = Simulink.Bus()
  Lft: LftForcesBUS
  Rght: RghtForcesBUS

RearWheelsBUS = Simulink.Bus()
  Wheels: RWheelsBUS
  Gnd: GndBUS

RghtBBUS = Simulink.Bus()
  Disp: DispBBUS
  Vel: VelBBUS

RghtIBUS = Simulink.Bus()
  Disp: DispIBUS
  Vel: VelIBUS

RghtTrlrBUS = Simulink.Bus()
  Disp: DispITrlrBUS

SteeringBUS = Simulink.Bus()
  Front: FrontBUS
  Rear: RearBUS

TiresBUS = Simulink.Bus()
  FrntTires: FrntTiresBUS
  RearTires: RearTiresBUS

TransInfoBUS = Simulink.Bus()
  Cltch1State: boolean
  Cltch2State: boolean
  Info: InfoBUS

VVCDrvCmdBUS = Simulink.Bus()
  SteerCmd: Bus: VVCSteerCmdAngBUS
  AccelCmd: Bus: VVCAccelCmdBUS
  DecelCmd: Bus: VVCDecelCmdBUS
  TransCmd: Bus: VVCTransCmdBUS
  LightsCmd: Bus: VVCLightsCmdBUS
  UserCmd: Bus: VVCUserBUS
  IgnModeCmd: int8, Unit="one"

VVCEnvGndBUS = Simulink.Bus()
  BaroPress: double, Min=0, Unit="pascal"
  AmbTemp: double, Min=0, Unit="kelvin"
  Wind: double[3], Unit="m/s"  % Wind veloicty in the global inertial frame
  Grade: double, Min=0, Unit="deg"
  Gnd: Bus: VVCGndSTI4wBUS

VVCLightsCmdBUS = Simulink.Bus()
  HighBeamCmd: boolean
  LowBeamCmd: boolean
  BrakeLightCmd: boolean
  ReverseLightCmd: boolean
  LeftSignalCmd: boolean
  RightSignalCmd: boolean
  FrntFogCmd: boolean
  RearFogCmd: boolean
  TailLightCmd: boolean
  HazzardCmd: boolean
  UserCmd: Bus: VVCUserBUS

VVCVehFdbkBUS = Simulink.Bus()
  Driver: Bus: DriverBUS
  Body: Bus: VehBodyBUS
  Driveline: Bus: DrivelineBUS

VehBodyBUS = Simulink.Bus()
  InertFrm: InertFrmBUS
  BdyFrm: BdyFrmBUS

VehFdbkBUS = Simulink.Bus()
  Driver: DriverBUS
  Body: VehBodyBUS
  FrntWheels: FrntWheelsBUS
  Trans: TransInfoBUS
  Steering: SteeringBUS
  Battery: BatteryBUS
  EM: EMBUS
  FuelCell: FuelCellBUS
  Engine: EngineBUS
  FrntSuspension: FrntSuspBUS
  TrlrBody: TrlrBodyBUS
  TrlrWheels: TrlrWheelsBUS
  RearWheels: RearWheelsBUS
  RearSuspension: RearSuspBUS
  IMU: IMUBUS
  Env: VVCEnvGndBUS
  Thermal: ThermalBUS
  DCDC: DCDCBUS

slBus17_RearAxlBUS = Simulink.Bus()
  Lft: LftTrlrBUS
  Rght: RghtTrlrBUS

slBus19_CgBUS = Simulink.Bus()
  Disp: DispITrlrBUS

slBus20_InertFrmBUS = Simulink.Bus()
  FrntAxl: slBus7_FrntAxlBUS
  MidlAxl: MidlAxlBUS
  RearAxl: slBus17_RearAxlBUS
  Cg: slBus19_CgBUS

slBus7_FrntAxlBUS = Simulink.Bus()
  Lft: LftTrlrBUS
  Rght: RghtTrlrBUS

TrlrBdyFrmBUS = Simulink.Bus()
  Cg: Bus: TrlrCgBBUS
  Forces: Bus: TrlrForcesBUS
  Moments: Bus: TrlrMomentsBUS
  FrntAxl: Bus: TrlrFrntAxlBBUS
  HitchF: Bus: HitchBBUS
  HitchR: Bus: HitchBBUS
  Pwr: Bus: TrlrPwrBUS
  Geom: Bus: GeomBBUS

TrlrBodyBUS = Simulink.Bus()
  InertFrm: Bus: TrlrInertFrmBUS
  BdyFrm: Bus: TrlrBdyFrmBUS
  Hitch: double[6]
  Suspension: Bus: TrlrSuspensionBUS

TrlrCgBBUS = Simulink.Bus()
  Vel: Bus: VelBBUS
  Ang: Bus: AngGeomBUS
  AngVel: Bus: AngVelBUS
  Acc: Bus: AccBUS
  AngAcc: Bus: AngAccBUS

TrlrForcesBUS = Simulink.Bus()
  Body: Bus: BodyBUS
  Ext: Bus: ExtBUS
  HitchF: Bus: HitchForcesBUS
  HitchR: Bus: HitchForcesBUS
  FrntAxl: Bus: FrntAxlForcesBUS
  Tires: Bus: TrlrFrntTiresBUS
  Drag: Bus: DragBUS
  Grvty: Bus: GrvtyBUS

TrlrFrntTiresBUS = Simulink.Bus()
  FrntTires: Bus: FrntTiresBUS

TrlrInertFrmBUS = Simulink.Bus()
  Cg: Bus: CgIBUS
  FrntAxl: Bus: FrntAxlIBUS
  HitchF: Bus: HitchIBUS
  HitchR: Bus: HitchIBUS
  Geom: Bus: GeomIBUS

TrlrMomentsBUS = Simulink.Bus()
  Body: BodyMBUS
  Drag: DragMBUS
  Ext: ExtMBUS
  HitchF: HitchMomentsBUS
  HitchR: Bus: HitchMomentsBUS

TrlrWheelsBUS = Simulink.Bus()
  Wheels: Bus: TrlrWhlBUS
  Gnd: Bus: GndBUS

TrlrWhlBUS = Simulink.Bus()
  TireFrame: Bus: TrlrTireFrameBUS
  Steering: Bus: TrlrSteeringBUS

FWheelsBUS = Simulink.Bus()
  AxlTrq: double[PlntWhlNumFrnt]
  Omega: Bus: OmegaBUS
  Fx: Bus: FxBUS
  Fy: double[PlntWhlNumFrnt]
  Fz: double[PlntWhlNumFrnt]
  Mx: double[PlntWhlNumFrnt]
  My: double[PlntWhlNumFrnt]
  Mz: double[2]
  Vx: double[2]
  Vy: double[2]
  Re: double[2]
  Kappa: double[2]
  Alpha: double[2]
  a: double[2]
  b: double[2]
  Gamma: double[2]
  psidot: double[2]
  BrkTrq: double[2]
  BrkPrs: double[2]
  z: double[2]
  zdot: double[2]
  Gnd: double[2]
  GndFz: double[2]
  Prs: double[2]

RWheelsBUS = Simulink.Bus()
  AxlTrq: double[PlntWhlNumRear]
  Omega: Bus: OmegaBUS
  Fx: Bus: FxBUS
  Fy: double[PlntWhlNumRear]
  Fz: double[PlntWhlNumRear]
  Mx: double[PlntWhlNumRear]
  My: double[PlntWhlNumRear]
  Mz: double[2]
  Vx: double[2]
  Vy: double[2]
  Re: double[2]
  Kappa: double[2]
  Alpha: double[2]
  a: double[2]
  b: double[2]
  Gamma: double[2]
  psidot: double[2]
  BrkTrq: double[2]
  BrkPrs: double[2]
  z: double[2]
  zdot: double[2]
  Gnd: double[2]
  GndFz: double[2]
  Prs: double[2]

TrlrFrntAxlBBUS = Simulink.Bus()
  Lft: Bus: LftBBUS
  Rght: Bus: RghtBBUS

ContactorsCmdBUS = Simulink.Bus()
  PosContactorChgrCmd: boolean
  PreChargeRelayChgrCmd: boolean
  NegContactorChgrCmd: boolean
  PosContactorInvtrCmd: boolean
  PreChargeRelayInvtrCmd: boolean
  NegContactorInvtrCmd: boolean

CurrentLimitsBUS = Simulink.Bus()
  DischargeCurrentLimit: single
  ChargeCurrentLimit: single

BdyFrmBUS = Simulink.Bus()
  Cg: CgBBUS
  Forces: ForcesBUS
  Moments: MomentsBUS
  FrntAxl: FrntAxlBBUS
  RearAxl: RearAxlBBUS
  Hitch: HitchBBUS
  Pwr: PwrBUS
  Geom: GeomBBUS